# Grasshopper definition basic_truss_design_python.gh (Grasshopper 1.0.8)
# plug-ins: RhinoCodePluginGH

number_slider = Slider(5, range=0..10)  # disabled
number_slider_2 = Slider(2, range=0..10)  # disabled
num = Number(Slider(2, range=0..10))
int = Integer(Slider(5, range=0..10))
num_2 = Number(Slider(5, range=0..10))
num_3 = Number(number_slider_2)  # disabled
int_2 = Integer(number_slider)  # disabled
py3 = Python3Script(n=int, h=num, span=num_2)  # -> out, Bottom, Top, Webs
# ---------- py3: Python ----------
"""Grasshopper Script"""
"""Simple triangular truss
Inputs:
  n    : number of panels (int)
  span : total length (float)
  h    : truss height (float)
Outputs:
  pts   : list of points
  lines : list of lines
"""
import rhinoscriptsyntax as rs

"""Mini Warren truss (with top chord)
Inputs:
  n    : number of panels (int >= 1)
  span : total length
  h    : height
Outputs:
  Bottom : list of line ids (bottom chord)
  Top    : list of line ids (top chord)
  Webs   : list of line ids (zig-zag)
"""
import rhinoscriptsyntax as rs

dx = float(span) / n

# bottom and top nodes
B = [rs.AddPoint(i*dx, 0, 0) for i in range(n+1)]
T = [rs.AddPoint((i+0.5)*dx, h, 0) for i in range(n)]

# chords
Bottom = [rs.AddLine(B[i], B[i+1]) for i in range(n)]
Top    = [rs.AddLine(T[i], T[i+1]) for i in range(n-1)] if n > 1 else []

# zig-zag webs
Webs = []
for i in range(n):
    Webs.append(rs.AddLine(B[i],   T[i]))
    Webs.append(rs.AddLine(T[i],   B[i+1]))
# ---------- end py3 ----------
py3_2 = Python3Script(n=int_2, r=num_3)  # -> out, Lines, Pts; disabled
# ---------- py3_2: Python ----------
"""Grasshopper Script"""
"""Simple triangular truss
Inputs:
  n    : number of panels (int)
  span : total length (float)
  h    : truss height (float)
Outputs:
  pts   : list of points
  lines : list of lines
"""
import rhinoscriptsyntax as rs
"""Starburst pattern
Inputs:
  n   : number of rays
  r   : radius
Outputs:
  center : the central point
  pts    : list of end points
  lines  : list of lines
"""
import rhinoscriptsyntax as rs
import math

center = rs.AddPoint(0,0,0)
Pts = []
Lines = []

for i in range(n):
    angle = (2*math.pi/n) * i
    x = math.cos(angle) * r
    y = math.sin(angle) * r
    pt = rs.AddPoint(x,y,0)
    Pts.append(pt)
    Lines.append(rs.AddLine(center, pt))
# ---------- end py3_2 ----------
crv = Curve(py3.Webs)
crv_2 = Curve(py3.Bottom)
crv_3 = Curve(py3.Top)
pt = Point(py3_2.Pts)  # disabled
crv_4 = Curve(py3_2.Lines)  # disabled
