# Grasshopper definition build_curved_volume.gh (Grasshopper 1.0.7)

number = Number(Slider(1.31, range=0..5))
number_2 = Number(Slider(2.13, range=0..5))
number_3 = Number(Slider(1.95, range=0..5))
number_4 = Number(Slider(2.37, range=0..5))
number_5 = Number(Slider(1.89, range=0..5))
number_6 = Number(Slider(0.65, range=0..5))
number_7 = Number(Slider(10, range=0..20))
number_8 = Number(Slider(10, range=0..10))
number_9 = Number(Slider(3, range=0..10))
number_10 = Number(Slider(2, range=0..10))
number_11 = Number(Slider(1.04, range=0..10))
number_12 = Number(Slider(2.33, range=0..10))
number_13 = Number(Slider(0.66, range=0..10))
number_14 = Number(Slider(0.37, range=0..10))
construct_point = ConstructPoint(XCoordinate=0, YCoordinate=0, ZCoordinate=expr("x/2", number_7))
construct_point_2 = ConstructPoint(XCoordinate=0, YCoordinate=0, ZCoordinate=0)
construct_point_3 = ConstructPoint(XCoordinate=0, YCoordinate=0, ZCoordinate=number_7)
construct_domain = ConstructDomain(DomainStart=0, DomainEnd=number_8)
merge = Merge(Data1=number, Data2=number_3, Data3=number_2)
merge_2 = Merge(Data1=number_4, Data2=number_6, Data3=number_5)
integer = Integer(Slider(43, range=-180..180))
integer_2 = Integer(Slider(44, range=-180..180))
integer_3 = Integer(Slider(63, range=-180..180))
range = Range(Domain=construct_domain, Steps=Slider(10, range=0..10))
point = Point(construct_point_2)
point_2 = Point(construct_point_3)
point_3 = Point(construct_point)
construct_point_4 = ConstructPoint(XCoordinate=0, YCoordinate=0, ZCoordinate=expr("x/2", number_8))
construct_point_5 = ConstructPoint(XCoordinate=0, YCoordinate=0, ZCoordinate=0)
construct_point_6 = ConstructPoint(XCoordinate=0, YCoordinate=0, ZCoordinate=number_8)
merge_3 = Merge(Data1=point, Data2=point_3, Data3=point_2)
point_4 = Point(construct_point_6)
point_5 = Point(construct_point_5)
point_6 = Point(construct_point_4)
merge_4 = Merge(Data1=integer, Data2=integer_2, Data3=integer_3)
number_15 = Number(merge)
number_16 = Number(merge_2)
point_7 = Point(merge_3)
circle = Circle(Plane=point_7, Radius=number_16)
radians = Radians(Degrees=merge_4)
ellipse = Ellipse(Plane=point_7, Radius1=number_16, Radius2=number_15)  # -> Ellipse, Focus1, Focus2
curve = Curve(ellipse.Ellipse)
rotate = Rotate(Geometry=curve, Angle=radians, Plane=PlaneXY(0, 0, 0))  # -> Geometry, Transform
merge_5 = Merge(Data1=number_12, Data2=number_14, Data3=number_13)
merge_6 = Merge(Data1=number_9, Data2=number_11, Data3=number_10)
merge_7 = Merge(Data1=point_5, Data2=point_6, Data3=point_4)
panel = Panel("""0
45
90""")
curve_2 = Curve(circle)
circle_2 = Circle(Plane=merge_7, Radius=merge_6)
point_8 = Point(merge_7)
e = Plane(point_8)
curve_3 = Curve(rotate.Geometry)
ellipse_2 = Ellipse(Plane=e, Radius1=merge_6, Radius2=merge_5)  # -> Ellipse, Focus1, Focus2
loft = Loft(Curves=curve_2, Options={Adjust=False, Closed=False, LoftEnds=0, LoftSimp=0, LoftType=0, Rebuild=10, Refit=0.01})
radians_2 = Radians(Degrees=panel)
loft_2 = Loft(Curves=curve_3, Options={Adjust=False, Closed=False, LoftEnds=0, LoftSimp=0, LoftType=0, Rebuild=10, Refit=0.01})
rotate_2 = Rotate(Geometry=ellipse_2.Ellipse, Angle=radians_2, Plane=PlaneXY(0, 0, 0))  # -> Geometry, Transform
surface = Surface(loft)
number_17 = Number("1")
surface_2 = Surface(loft_2)
number_18 = Number(Slider(10, range=0..10))
contour = Contour(Shape=surface_2, Point=Point(0, 0, 0), Direction=Vector(0, 0, 1), Distance=number_17)
curve_4 = Curve(ellipse_2.Ellipse)
curve_5 = Curve(rotate_2.Geometry)
curve_6 = Curve(circle_2)
loft_3 = Loft(Curves=curve_4, Options={Adjust=False, Closed=False, LoftEnds=0, LoftSimp=0, LoftType=0, Rebuild=10, Refit=0.01})
loft_4 = Loft(Curves=curve_5, Options={Adjust=False, Closed=False, LoftEnds=0, LoftSimp=0, LoftType=0, Rebuild=10, Refit=0.01})
loft_5 = Loft(Curves=curve_6, Options={Adjust=False, Closed=False, LoftEnds=0, LoftSimp=0, LoftType=0, Rebuild=10, Refit=0.01})
curve_7 = Curve(contour)
integer_4 = Integer(Slider(10, range=0..20))
surface_3 = Surface(loft_3)
surface_4 = Surface(loft_4)
contour_2 = Contour(Shape=surface_4, Point=Point(0, 0, 0), Direction=Vector(0, 0, 1), Distance=Slider(1, range=0..10))
curve_8 = Curve(contour_2)
divide_curve = DivideCurve(Curve=curve_8, Count=number_18, Kinks=False)  # -> Points, Tangents, Parameters
flip_matrix = FlipMatrix(Data=divide_curve.Points)
interpolate = Interpolate(Vertices=divide_curve.Points, Degree=Toggle(True), Periodic=False, KnotStyle=1)  # -> Curve, Length, Domain
interpolate_2 = Interpolate(Vertices=flip_matrix, Degree=3, Periodic=False, KnotStyle=1)  # -> Curve, Length, Domain
surface_5 = Surface(loft_5)
divide_curve_2 = DivideCurve(Curve=curve_7, Count=integer_4, Kinks=False)  # -> Points, Tangents, Parameters
boundary_surfaces = BoundarySurfaces(Edges=curve_7)
curve_9 = Curve(interpolate.Curve)
surface_6 = Surface(contour_2)
curve_10 = Curve(interpolate_2.Curve)
custom_preview = CustomPreview(Geometry=surface_6, Material=ColourSwatch(SwatchColor=RGB(0, 0, 0)))
pipe = Pipe(Curve=curve_10, Radius=Slider(0.05, range=0..1), Caps=0)
point_9 = Point(simplify(divide_curve_2.Points))
surface_7 = Surface(boundary_surfaces)
panel_2 = Panel(divide_curve_2.Points)
flip_matrix_2 = FlipMatrix(Data=point_9)
interpolate_3 = Interpolate(Vertices=flip_matrix_2, Degree=3, Periodic=False, KnotStyle=1)  # -> Curve, Length, Domain
pipe_2 = Pipe(Curve=interpolate_3.Curve, Radius=Slider(0.2, range=0..1), Caps=0)
